# Dynamo graph Dynamo Extract Areas.dyn (Dynamo 2.0.2.6826)

# group: Functions
code_block = CodeBlock()
# ---------- code_block.designscript (9 lines) ----------
def comparexmax(xmin:var[],ymin:var[],xmax:var[],ymax:var[],num,con)
{
   return=[Imperative]
   {
   	rlist = [];
    for (i in 0..List.Count(xmin)-1) rlist[i] = (xmax[con]==xmin[i])&&(ymin[i]<ymax[con])&&(ymax[i]>ymin[con]);
      return = rlist;
	}
};
# ----------------------------------------
code_block_2 = CodeBlock()
# ---------- code_block_2.designscript (9 lines) ----------
def comparexmin(xmin:var[],ymin:var[],xmax:var[],ymax:var[],num,con)
{
   return=[Imperative]
   {
   	rlist = [];
    for (i in 0..num) rlist[i] = (xmin[con]==xmax[i])&&(ymin[i]<ymax[con])&&(ymax[i]>ymin[con]);
      return = rlist;
	}
};
# ----------------------------------------
code_block_3 = CodeBlock()
# ---------- code_block_3.designscript (9 lines) ----------
def compareymin(xmin:var[],ymin:var[],xmax:var[],ymax:var[],num,con)
{
   return=[Imperative]
   {
   	rlist = [];
    for (i in 0..num) rlist[i] = (ymin[con]==ymax[i])&&(xmin[i]<xmax[con])&&(xmax[i]>xmin[con]);
      return = rlist;
	}
};
# ----------------------------------------
code_block_4 = CodeBlock()
# ---------- code_block_4.designscript (9 lines) ----------
def compareymax(xmin:var[],ymin:var[],xmax:var[],ymax:var[],num,con)
{
   return=[Imperative]
   {
   	rlist = [];
    for (i in 0..num) rlist[i] = (ymax[con]==ymin[i])&&(xmin[i]<xmax[con])&&(xmax[i]>xmin[con]);
      return = rlist;
	}
};
# ----------------------------------------
code_block_5 = CodeBlock()
# ---------- code_block_5.designscript (9 lines) ----------
def mo(l1:var[])
{
   return=[Imperative]
   {
   	l2 = [];
    for (i in 0..List.Count(l1)-1) l2[i] = l1[i]+1;
      return = l2;
	}
};
# ----------------------------------------
code_block_6 = CodeBlock()
# ---------- code_block_6.designscript (9 lines) ----------
def m2(l1:string[])
{
   return=[Imperative]
   {
   	l2 = [];
    for (i in 0..List.Count(l1)-1) l2[i] = l1[i]+"dub";
      return = l2;
	}
};
# ----------------------------------------
code_block_7 = CodeBlock()
# ---------- code_block_7.designscript (9 lines) ----------
def compfloop2(nam:string[],l0:var[],l1:var[],l2:var[],l3:var[])
{
   return=[Imperative]
   {
   	thegreatlist = [];
    for (i in 0..List.Count(l0)-1) thegreatlist[i] = compareall(nam,l0,l1,l2,l3,i);
      return = thegreatlist;
	}
};
# ----------------------------------------

# group: Extract Geometry
categories = Categories(index=416)  # graph input
all_elements_of_category = ElementsOfCategory(Category=categories)
watch = Watch(all_elements_of_category)
string = StringInput("Number")  # graph input
getParameterValueByName = Element.GetParameterValueByName(element=all_elements_of_category, parameterName=string)
code_block_8 = CodeBlock { ["1","2","3","4","5","6","7","8","9"]; }
allIndicesOf = List.AllIndicesOf(list=getParameterValueByName, item=code_block_8)
flatten = List.Flatten(list=allIndicesOf)
getItemAtIndex = List.GetItemAtIndex(list=watch, index=flatten)
string_2 = StringInput("Number")  # graph input
getParameterValueByName_2 = Element.GetParameterValueByName(element=getItemAtIndex, parameterName=string_2)
watch_2 = Watch(getParameterValueByName_2)
string_3 = StringInput("Name")  # graph input
getParameterValueByName_3 = Element.GetParameterValueByName(element=getItemAtIndex, parameterName=string_3)
watch_3 = Watch(getParameterValueByName_3)
geometry = Element.Geometry(element=getItemAtIndex)
byGeometry = BoundingBox.ByGeometry(geom=geometry)
string_4 = StringInput("Name")  # graph input
addItemToFront = List.AddItemToFront(item=string_4, list=watch_3)

# group: Lists
maxPoint = BoundingBox.MaxPoint(boundingBox=byGeometry)
number = DoubleInput(2)  # graph input
minPoint = BoundingBox.MinPoint(boundingBox=byGeometry)
number_2 = DoubleInput(2)  # graph input
number_3 = DoubleInput(2)  # graph input
number_4 = DoubleInput(2)  # graph input

asVector = Point.AsVector(point=maxPoint)

# group (continued): Lists
X = Vector.X(vector=asVector)
XMAX = Math.Round(number=X, digits=number)

asVector_2 = Point.AsVector(point=minPoint)

# group (continued): Lists
X_2 = Vector.X(vector=asVector_2)
XMIN = Math.Round(number=X_2, digits=number_2)
XDIM = XMAX - XMIN

asVector_3 = Point.AsVector(point=maxPoint)

# group (continued): Lists
Y = Vector.Y(vector=asVector_3)
YMAX = Math.Round(number=Y, digits=number_3)

asVector_4 = Point.AsVector(point=minPoint)

# group (continued): Lists
Y_2 = Vector.Y(vector=asVector_4)
YMIN = Math.Round(number=Y_2, digits=number_4)
YDIM = YMAX - YMIN
mul = XDIM * YDIM
code_block_9 = CodeBlock(nam=watch_3, xmin=XMIN, ymin=YMIN, xmax=XMAX, ymax=YMAX) { nam; xmin; ymin; xmax; ymax; }
code_block_10 = CodeBlock(nam=code_block_9.nam, l0=code_block_9.xmin, l1=code_block_9.ymin, l2=code_block_9.xmax, l3=code_block_9.ymax) { compfloop(nam,l0,l1,l2,l3); }
watch_4 = Watch(code_block_10)

# group: Make Lists
string_5 = StringInput("Typology")  # graph input
addItemToFront_2 = List.AddItemToFront(item=string_5, list=watch_2)
string_6 = StringInput("X Dim")  # graph input
addItemToFront_3 = List.AddItemToFront(item=string_6, list=XDIM)
string_7 = StringInput("Y Dim")  # graph input
addItemToFront_4 = List.AddItemToFront(item=string_7, list=YDIM)
string_8 = StringInput("Area")  # graph input
addItemToFront_5 = List.AddItemToFront(item=string_8, list=mul)
string_9 = StringInput("Adj")  # graph input
addItemToFront_6 = List.AddItemToFront(item=string_9, list=watch_4)

list_create = List.Create(item0=addItemToFront_2, item1=addItemToFront, item2=addItemToFront_3, item3=addItemToFront_4, item4=addItemToFront_5, item5=addItemToFront_6)
transpose = List.Transpose(lists=list_create)

# group: Export to Excel
create = List.Create(item0=watch_2, item1=watch_3, item2=XDIM, item3=YDIM, item4=mul, item5=watch_4, item6=XMIN, item7=YMIN)
watch_5 = Watch(create)
transpose_2 = List.Transpose(lists=create)
watch_6 = Watch(transpose_2)
file_path = Filename("C:\Users\Martin Stacey\Desktop\ExtractAreas\EA.xlsx")  # graph input
string_10 = StringInput("sheet1")  # graph input
number_5 = DoubleInput(1)  # graph input
boolean = BoolSelector(true)  # graph input
exportExcel = Data.ExportExcel(filePath=file_path, sheetName=string_10, startRow=number_5, startCol=number_5, data=transpose, overWrite=boolean)

code_block_11 = CodeBlock()
# ---------- code_block_11.designscript (53 lines) ----------
def comparealltest(nam:string[],xmin:var[],ymin:var[],xmax:var[],ymax:var[],con)
{
   return=[Imperative]
   {
   	rl = [];
	rl1=[];
	rl2=[];
	rl3=[];
   	rstr = [];
   	rstr1 = [];
   	rstr2 = [];
   	rstr3 = [];
   	rstrtot=[];
   	rsf=[];
   	rs2="";
    for (i in 0..List.Count(xmin)-1) rl[i] = (xmax[con]==xmin[i])&&(ymin[i]<ymax[con])&&(ymax[i]>ymin[con]);
	for (i in 0..List.Count(xmin)-1) rl1[i] = (xmin[con]==xmax[i])&&(ymin[i]<ymax[con])&&(ymax[i]>ymin[con]);
	for (i in 0..List.Count(xmin)-1) rl2[i] = (ymin[con]==ymax[i])&&(xmin[i]<xmax[con])&&(xmax[i]>xmin[con]);
	for (i in 0..List.Count(xmin)-1) rl3[i] = (ymax[con]==ymin[i])&&(xmin[i]<xmax[con])&&(xmax[i]>xmin[con]);
    for (i in 0..List.Count(xmin)-1)
	{
		if (rl[i])  rstr [i] = nam [i] + ",";
    	else rstr [i] = "nope";
    	if (rl1[i])  rstr1 [i] = nam [i] + ",";
    	else rstr1 [i] = "nope";
    	if (rl2[i])  rstr2 [i] = nam [i]+ ",";
    	else rstr2 [i] = "nope";
    	if (rl3[i])  rstr3 [i] = nam [i]+ ",";
    	else rstr3 [i] = "nope";
	}
	for (i in 0..List.Count(xmin)-1) rstrtot[i] = rstr[i];
	for (i in 0..List.Count(xmin)-1) rstrtot[i+List.Count(xmin)] = rstr1[i];
	for (i in 0..List.Count(xmin)-1) rstrtot[i+(List.Count(xmin)*2)] = rstr2[i];
	for (i in 0..List.Count(xmin)-1) rstrtot[i+(List.Count(xmin)*3)] = rstr3[i];
	counter = 0;
	for (i in 0..List.Count(rstrtot)-1)
	{
		if (rstrtot[i]!="nope")
		{
			rsf[counter] = rstrtot[i];
			counter=counter+1;
		}
	}
	rs2 = String.Concat(rsf);
	rs2 = rsf;
	return = rs2;
	}
};
def compareall(nam:string[],xmin:var[],ymin:var[],xmax:var[],ymax:var[],con){
ree =  comparealltest(nam,xmin,ymin,xmax,ymax,con);
t4 = String.Concat(ree);
return = t4;
};
# ----------------------------------------
code_block_12 = CodeBlock()
# ---------- code_block_12.designscript (17 lines) ----------
def compfloop(nam:string[],l0:var[],l1:var[],l2:var[],l3:var[])
{
thegreatlist = [];
return = [Imperative]{
for (i in 0..List.Count(l0)-1) thegreatlist[i] = compareall(nam,l0,l1,l2,l3,i);
return = thegreatlist;
}

  // return=[Imperative]
   //{
   	//thegreatlist = [];
    //for (i in 0..List.Count(l0)-1) thegreatlist[i] = compareall(nam,l0,l1,l2,l3,i);
      //return = thegreatlist;
	//}
	//}

};
# ----------------------------------------
