# Dynamo graph Rotate Elements own Axis.dyn (Dynamo 2.0.2.6826)

select_model_elements = DSModelElementsSelection()  # 12 picked in the model
code_block = CodeBlock { 60; }
setRotation = FamilyInstance.SetRotation(familyInstance=select_model_elements, degree=code_block)
