# Dynamo graph Rename Room Names by Floor and Number.dyn "Change Room Names by Floor and Number" (Dynamo 2.0.2.6826)

categories = Categories(index=416)
all_elements_of_category = ElementsOfCategory(Category=categories)
code_block = CodeBlock { "Name"; }
code_block_2 = CodeBlock { "-"; }
concat = String.Concat(string1=code_block_2)  # unwired: string0, string2
code_block_3 = CodeBlock { "Level"; }
getParameterValueByName = Element.GetParameterValueByName(element=all_elements_of_category, parameterName=code_block_3)
code_block_4 = CodeBlock { 0; }
length = String.Length(str=getParameterValueByName)
code_block_5 = CodeBlock { 1; }
sub = length - code_block_5
remove = String.Remove(str=getParameterValueByName, startIndex=code_block_4, count=sub)
watch = Watch(remove)
code_block_6 = CodeBlock { "Number"; }
getParameterValueByName_2 = Element.GetParameterValueByName(element=all_elements_of_category, parameterName=code_block_6)
combine = List.Combine(comb=concat, list1=watch, list2=getParameterValueByName_2)
setParameterByName = Element.SetParameterByName(element=all_elements_of_category, parameterName=code_block, value=combine)
