# Dynamo graph Rename Rooms.dyn (Dynamo 2.0.2.6826)

categories = Categories(index=416)
all_elements_of_category = ElementsOfCategory(Category=categories)
code_block = CodeBlock { "Name"; }
code_block_2 = CodeBlock { "Departamento "; }
string = StringInput("Number")
getParameterValueByName = Element.GetParameterValueByName(element=all_elements_of_category, parameterName=string)
add = code_block_2 + getParameterValueByName
setParameterByName = Element.SetParameterByName(element=all_elements_of_category, parameterName=code_block, value=add)
