# Dynamo graph Create Empty Sheets.dyn "Create Sheets" (Dynamo 2.0.2.6826)

family_types = FamilyTypes(index=0)
code_block = CodeBlock { ["A01","A02","A03","A04"]; ["Planta Baja","Planta Alta","Corte 1","Corte 2"]; }
boolean = BoolSelector(false)
createEmptySheet = Custom[Tool.CreateEmptySheet](Type_TitleBlock=family_types, Numbers=code_block.out0, Names=code_block.out1, Refresh=boolean)  # Add the amount of sheets from titleblock type. numbers and names are set from lists
