# Dynamo graph Create Sheets with Details.dyn (Dynamo 2.0.2.6826)

family_types = FamilyTypes(index=0)
code_block = CodeBlock()
# ---------- code_block.designscript (2 lines) ----------
["600","601","602","603"];
["Planta General de Ventanas Piso 1"," Planta General de Ventanas Piso 2", "Planta Alta","Cortes", "Fachadas"];
# ----------------------------------------
boolean = BoolSelector(false)
createEmptySheet = Custom[Tool.CreateEmptySheet](Type_TitleBlock=family_types, Numbers=code_block.out0, Names=code_block.out1, Refresh=boolean)  # Add the amount of sheets from titleblock type. numbers and names are set from lists
code_block_2 = CodeBlock { "Approved By"; "LDS + Huskell"; "Designed By"; "RVC"; }
setParameterByName = Element.SetParameterByName(element=createEmptySheet, parameterName=code_block_2.out0, value=code_block_2.out1)
setParameterByName_2 = Element.SetParameterByName(element=setParameterByName, parameterName=code_block_2.out2, value=code_block_2.out3)
