# Dynamo graph Create Sheets with Views.dyn (Dynamo 2.0.2.6826)

code_block = CodeBlock { "Planta Baja"; "A1"; "Cortes"; "A2"; }
family_types = FamilyTypes(index=0)
views = Views(index=7)
views_2 = Views(index=20)
list_create = List.Create(item0=views, item1=views_2)
byNameNumberTitleBlockAndViews = Sheet.ByNameNumberTitleBlockAndViews(sheetName=code_block.out2, sheetNumber=code_block.out3, titleBlockFamilyType=family_types, views=list_create)
views_3 = Views(index=14)
byNameNumberTitleBlockAndView = Sheet.ByNameNumberTitleBlockAndView(sheetName=code_block.out0, sheetNumber=code_block.out1, titleBlockFamilyType=family_types, view=views_3)
