# Dynamo graph All Window Heigths Same.dyn (Dynamo 2.0.2.6826)

select_model_elements = DSModelElementsSelection()  # 23 picked in the model
code_block = CodeBlock { "Head Height"; 2; }
setParameterByName = Element.SetParameterByName(element=select_model_elements, parameterName=code_block.out0, value=code_block.out1)
code_block_2 = CodeBlock()  # //use temporary select
