# Dynamo graph 04 SquaremMetersCost.dyn (Dynamo 1.3.2.2480)

restriction = CodeBlock { {5,5}; }
costm2 = CodeBlock { 2000; }
regular_site = CodeBlock { front = 20; side=40; }
byWidthLength = Rectangle.ByWidthLength(width=regular_site.front, length=regular_site.side)
byPatch = Surface.ByPatch(byWidthLength)
front_restriction = DoubleSlider(4.2, range=0..10 step 0.1)
back_restriction = DoubleSlider(3.5, range=0..10 step 0.1)

# group: Surface Width Restrictions
perimeterCurves = Surface.PerimeterCurves(byPatch)
lines_extraction = CodeBlock { {1,3}; }
getItemAtIndex = List.GetItemAtIndex(list=perimeterCurves, index=lines_extraction)
code_block = CodeBlock { 0.5; }
pointAtParameter = Curve.PointAtParameter(curve=getItemAtIndex, param=code_block)
byCoordinates = Point.ByCoordinates()
byTwoPoints = Vector.ByTwoPoints(start=pointAtParameter, end=byCoordinates)
create = List.Create(front_restriction, back_restriction)
translate = Geometry.Translate(geometry=getItemAtIndex, direction=byTwoPoints, distance=create)

byLoft = Surface.ByLoft(translate)
levels = DoubleSlider(10, range=5..12 step 1)
height = DoubleSlider(4, range=2.4..4 step 0.2)
code_block_2 = CodeBlock(b=levels, c=height) { 0..#b..c; }
offset = Surface.Offset(byLoft, code_block_2)
area = Surface.Area(offset)
sum = Math.Sum(area)
code_block_3 = CodeBlock(a=costm2, b=sum) { a*b; }
total_cost = Watch(code_block_3)
