# Dynamo custom node SCH FF1.dyf (Dynamo 0.9.1.4062)
# category: Optimo
# Fitness Function for SCH Optimization

List = Input()
firstItem = List.FirstItem(List)
code_block = CodeBlock { 2; }
pow = Math.Pow(number=firstItem, power=code_block)
double = Output(pow)
