# Dynamo graph ShapeOptimizationDYNAMO202.dyn "ShapeOptimization" (Dynamo 2.0.2.6826)

file_path = Filename("..\..\..\..\..\..\..\..\Desktop\m1.csv")
code_block = CodeBlock { 1; }
population_size = CodeBlock { population = 50; iterations = 0; nobjectives = 1; lowlimit = [0,0]; uplimit = [300,300]; }
initialSolutionList = Optimo.NSGA_II.InitialSolutionList(populationSize=population_size.population, numObjectives=population_size.nobjectives, lowerLimits=population_size.lowlimit, upperLimits=population_size.uplimit)
select_face = DSFaceSelection()  # 1 picked in the model
point_on_surface_fitness = Custom[Point on Surface Fitness Function](Face=select_face)  # The Fitness Function for Optimo's Point on Surface Example; unwired: Population_List
list_of_fitness_functions = List.Create(item0=point_on_surface_fitness)
apply = ApplyFunction(func=list_of_fitness_functions, arg1=initialSolutionList)  # "Function.Apply"
assignFitnessFuncResults = Optimo.NSGA_II.AssignFitnessFuncResults(populationList=initialSolutionList, FitnessList=apply)
create = List.Create(item0=code_block, item1=assignFitnessFuncResults)
loop_completion_check = Custom[Loop Completion Check](Iteration_Number=population_size.iterations)  # A function that checcks if the loop is completed; unwired: init
nsga_ii_function = Custom[NSGA_II Function](lowerLimits=population_size.lowlimit, upperLimits=population_size.uplimit, Fitness_Function_List=list_of_fitness_functions)  # The function that performs the generation for NSGA_II.; unwired: init
loopWhile = LoopWhile(init=create, continueWhile=loop_completion_check, loopBody=nsga_ii_function)
code_block_2 = CodeBlock(a=loopWhile) { a[1]; }  # frozen
exportCSV = Data.ExportCSV(filePath=file_path, data=code_block_2)
code_block_3 = CodeBlock { Point.ByCoordinates(300,300,150); }
byCenterPointRadius = Sphere.ByCenterPointRadius(centerPoint=code_block_3)
code_block_4 = CodeBlock(a=loopWhile) { a[1]; }
code_block_5 = CodeBlock(A=code_block_4) { Point.ByCoordinates(A[0],A[1],A[2]); }
code_block_6 = CodeBlock { 5; }
byCenterPointRadius_2 = Sphere.ByCenterPointRadius(centerPoint=code_block_5, radius=code_block_6)
code_block_7 = CodeBlock { 100; }
code_block_8 = CodeBlock { 2; }
getItemAtIndex = List.GetItemAtIndex(list=code_block_4, index=code_block_8)
minimumItem = List.MinimumItem(list=getItemAtIndex)
maximumItem = List.MaximumItem(list=getItemAtIndex)
code_block_9 = CodeBlock { 0; 255; }
mapTo = Math.MapTo(rangeMin=minimumItem, rangeMax=maximumItem, inputValue=getItemAtIndex, targetRangeMin=code_block_9.out0, targetRangeMax=code_block_9.out1)
byARGB = Color.ByARGB(a=code_block_7, r=mapTo, b=mapTo)
byGeometryColor = Modifiers.GeometryColor.ByGeometryColor(geometry=byCenterPointRadius_2, color=byARGB)
