# Dynamo graph CircleofParameters.dyn (Dynamo 2.0.2.6826)

# group: Circulo de Parametros
number_slider = DoubleSlider(4.7, range=0..100 step 0.1)
integer_slider = IntegerSlider(37, range=0..100 step 1)
python_script = Python(IN[0]=number_slider, IN[1]=number_slider, IN[2]=number_slider, IN[3]=integer_slider)
# ---------- python_script.python (35 lines) ----------
# Enable Python support and load DesignScript library
import clr
clr.AddReference('ProtoGeometry')
from Autodesk.DesignScript.Geometry import *

# The inputs to this node will be stored as a list in the IN variables.
radi = IN[0]
xin = IN [1]
yin = IN [2]
numpoints = IN[3]

import math

angles = []
angles = range (0,360,numpoints)



for i, angle in enumerate(angles):
	angles[i] = math.radians(angle)
	
xPoints = []
for x in angles:
	xPoints.append(radi*math.cos(x)+xin)

yPoints = []
for y in angles:
	yPoints.append(radi*math.sin(y)+yin)

PointList = []

for i, point in enumerate(xPoints):
	PointList.append(Point.ByCoordinates(point,yPoints[i],0))
	
OUT = PointList
# ----------------------------------------
