# Dynamo graph Dealing with List of Elements.dyn (Dynamo 2.0.2.6826)

# group: Manejar Listas de Elementos
select_model_elements = DSModelElementsSelection()  # 4 picked in the model
python_script = Python(IN[0]=select_model_elements)
# ---------- python_script.python (26 lines) ----------
# Enable Python support and load DesignScript library
import clr
clr.AddReference('ProtoGeometry')
from Autodesk.DesignScript.Geometry import *

# The inputs to this node will be stored as a list in the IN variables.
dataEnteringNode = IN
ElementList = []
if isinstance(IN[0],list):
	ElementList.extend(IN[0])
else:
	ElementList.append(IN[0])

ElementList = UnwrapElement(ElementList)
ParametersListParam = []
for a in ElementList:
	ParametersListParam.append(a.Parameters)
	
ParametersList = []
while len(ParametersList) != len(ParametersListParam):
	ParametersList.append([])
for list in ParametersListParam:
	for item in list :
		ParametersList[ParametersListParam.index(list)].append (item.Definition.Name)

OUT = ParametersList
# ----------------------------------------
watch = Watch(python_script)
