# Dynamo graph ExtractParameters.dyn (Dynamo 2.0.2.6826)

# group: Extraer Parametros
select_model_element = DSModelElementSelection()  # 1 picked in the model
unwrap_element = Python(IN[0]=select_model_element)
# ---------- unwrap_element.python (12 lines) ----------
# Enable Python support and load DesignScript library
import clr
clr.AddReference('ProtoGeometry')
from Autodesk.DesignScript.Geometry import *

# The inputs to this node will be stored as a list in the IN variables.
datain = UnwrapElement(IN[0])

# Place your code below this line

# Assign your output to the OUT variable.
OUT = datain
# ----------------------------------------
watch = Watch(unwrap_element)
select_model_element_2 = DSModelElementSelection()  # 1 picked in the model
get_parameters = Python(IN[0]=select_model_element_2)
# ---------- get_parameters.python (16 lines) ----------
# Enable Python support and load DesignScript library
import clr
clr.AddReference('ProtoGeometry')
from Autodesk.DesignScript.Geometry import *

# The inputs to this node will be stored as a list in the IN variables.
dataEnteringNode = IN

# Place your code below this line
elUW = UnwrapElement(IN[0])
#elementlist = elUW.Parameters
parametersList = []
for i in elUW.Parameters:
	parametersList.append(i)
	
OUT = parametersList
# ----------------------------------------
get_parameters_name = Python(IN[0]=select_model_element_2)
# ---------- get_parameters_name.python (16 lines) ----------
# Enable Python support and load DesignScript library
import clr
clr.AddReference('ProtoGeometry')
from Autodesk.DesignScript.Geometry import *

# The inputs to this node will be stored as a list in the IN variables.
dataEnteringNode = IN

# Place your code below this line
elUW = UnwrapElement(IN[0])
elParam = elUW.Parameters
ParamList = []
for i in elParam:
	ParamList.append(i.Definition.Name)
	
OUT = ParamList
# ----------------------------------------
watch_2 = Watch(get_parameters_name)
