# Dynamo graph ExtrusionandRotation.dyn (Dynamo 2.0.2.6826)

# group: Extrusion y Rotacion
number_slider = DoubleSlider(4.7, range=0..100 step 0.1)
integer_slider = IntegerSlider(37, range=0..100 step 1)
number_slider_2 = DoubleSlider(24.2, range=0..100 step 0.1)
python_script = Python(IN[0]=number_slider, IN[1]=number_slider, IN[2]=number_slider, IN[3]=integer_slider, IN[4]=number_slider, IN[5]=number_slider_2)
# ---------- python_script.python (39 lines) ----------
# Enable Python support and load DesignScript library
import clr
clr.AddReference('ProtoGeometry')
from Autodesk.DesignScript.Geometry import *
import math
#INS
radi = IN[0]
xin = IN [1]
yin = IN [2]
numpoints = IN[3]
extr = IN[4]

angles = []
angles = range (0,360,numpoints)
for i, angle in enumerate(angles):
	angles[i] = math.radians(angle)
xPoints = []
for x in angles:
	xPoints.append(radi*math.cos(x)+xin)
yPoints = []
for y in angles:
	yPoints.append(radi*math.sin(y)+yin)
pointlist = []
for i, point in enumerate(xPoints):
	pointlist.append(Point.ByCoordinates(point,yPoints[i],0))
#Polycurve
LineList = PolyCurve.ByPoints(pointlist,True)
Surface = LineList.Patch()
#Extrusion
Extrude = Surface.Thicken(extr)
#Rotation X Axis
PointOrigin = Point.ByCoordinates(0,0,0)
PointDisplaceX = Point.ByCoordinates(1,0,0)
VectorRotateX = Vector.ByTwoPoints(PointOrigin,PointDisplaceX)
GeometryRotateX = Extrude.Rotate(PointOrigin,VectorRotateX,IN[5])



OUT = GeometryRotateX
# ----------------------------------------
