# Dynamo graph Helloworld.dyn (Dynamo 2.0.2.6826)

# group: HelloWorld
code_block = CodeBlock { "Martin"; }
python_script = Python(IN[0]=code_block)
# ---------- python_script.python (12 lines) ----------
# Enable Python support and load DesignScript library
import clr
clr.AddReference('ProtoGeometry')
from Autodesk.DesignScript.Geometry import *

dataEnteringNode = IN
name = IN [0]

if name == None:
	name = "World"

OUT = "Hello " + name
# ----------------------------------------
watch = Watch(python_script)
python_script_2 = Python()  # unwired: IN[0]; same code as python_script
watch_2 = Watch(python_script_2)
