# Dynamo graph TaskDialogOptions.dyn (Dynamo 2.0.2.6826)

# group: Task Dialog, Options
code_block = CodeBlock { 17; 13; 31; 21; true; }
python_script = Python(IN[0]=code_block.out0, IN[1]=code_block.out1, IN[2]=code_block.out2, IN[3]=code_block.out3, IN[4]=code_block.out4)
# ---------- python_script.python (101 lines) ----------
import clr
clr.AddReference('ProtoGeometry')
from Autodesk.DesignScript.Geometry import *
#The inputs to this node will be stored as a list in the IN variables.

import math
import clr
clr.AddReference("RevitAPIUI")
from Autodesk.Revit.UI import *
#Points Creation

dataEnteringNode = IN
angles = []


angles = range(0, 360, 10)
for index, angle in enumerate(angles):
	angles[index] =  math.radians(angle)

xPoints = []

for x in angles:
	xPoints.append(IN[0]*math.cos(x))
	
	
yPoints = []

for x in angles:
	yPoints.append(IN[0]*math.sin(x))
	

pointlist = []

for index, point in enumerate(xPoints):
	pointlist.append(Point.ByCoordinates(point,yPoints[index],0))


#Policurve creation
	
Linelist = PolyCurve.ByPoints(pointlist, True)	

#Surface creation

Surface = Linelist.Patch()

#Extrusion creation

Extrude = Surface.Thicken(IN[0])


#Rotation

PointOrigin = Point.ByCoordinates(0,0,0)

#Rotation Axis x

PointDesplaceX = Point.ByCoordinates(1,0,0)

VectorRoateX = Vector.ByTwoPoints(PointOrigin, PointDesplaceX)

GeometryRotateX = Extrude.Rotate(PointOrigin, VectorRoateX, IN[1])

#Rotation Axis Y

PointDesplaceY = Point.ByCoordinates(0,1,0)

VectorRoateY = Vector.ByTwoPoints(PointOrigin, PointDesplaceY)

GeometryRotateY = GeometryRotateX.Rotate(PointOrigin, VectorRoateY, IN[2])

#Rotation Axis Z

PointDesplaceZ = Point.ByCoordinates(0,0,1)

VectorRoateZ = Vector.ByTwoPoints(PointOrigin, PointDesplaceZ)

GeometryRotateZ = GeometryRotateY.Rotate(PointOrigin, VectorRoateZ, IN[3])


SurfaceVolumne = str(round(Surface.Area,2))
TotalVolume = str(round(Extrude.Volume,2))

dialog = TaskDialog("Metric")
dialog.MainInstruction = "Values"
dialog.MainContent = "Surface:     " + SurfaceVolumne + "\n" + "Volume:      "+ TotalVolume

dialog.CommonButtons = TaskDialogCommonButtons.Ok;
dialog.DefaultButton = TaskDialogResult.Ok;


if Surface.Area > 500 :
	dialog.MainInstruction = "WARNING VALUE > 500"
	dialog.MainIcon = TaskDialogIcon.TaskDialogIconWarning;
	dialog.Show()
elif IN[4] == True :
	dialog.Show()
else :
	pass

#Assign your output to the OUT variable.
OUT =  GeometryRotateZ
# ----------------------------------------
