# Dynamo graph 01 FunctionsTest.dyn (Dynamo 1.3.3.4651)

ofstPointsFunction = Custom[OfstPointsFunction]()  # Offset Points Function
code_block = CodeBlock { gridOfst = 3; TDimOffs =2; IDimOffs =1; ColumnZ =5; SummitH = 8; trussH= 7; trussX= 2; }
code_block_2 = CodeBlock { NGrids = 6; gapGridsX = 6; BGrids = 2; gapGridsY = 18; }
gridLfromParam = Custom[GridLfromParam](GridsX=code_block_2.NGrids, gap_GridsX=code_block_2.gapGridsX, GridsY=code_block_2.BGrids, gap_GridsY=code_block_2.gapGridsY)  # Gets a GridList from Parameters
gridsfromGridL = Custom[GridsfromGridL](gridOfst=code_block.gridOfst, namesX=gridLfromParam.namesX, namesY=gridLfromParam.namesY, posXs=gridLfromParam.posXs, posYs=gridLfromParam.posYs)  # Grids Drawn From GridList
trussFramefromGridL = Custom[trussFramefromGridL](ColumnHeight=code_block.ColumnZ, summitHeight=code_block.SummitH, trussHeight=code_block.trussH, trussX=code_block.trussX, posXs=gridLfromParam.posXs, posYs=gridLfromParam.posYs)  # Truss Frame from GridL
wall_types = WallTypes("Exterior - Bloque en entramado metálico")
levels = Levels("Nivel 1")
LWallsFromGridL = Custom[LWallsFromGridL](ColumnHeight=code_block.ColumnZ, wallType=wall_types, wallLevel=levels, posXs=gridLfromParam.posXs, posYs=gridLfromParam.posYs)  # Lateral Walls From Grid List
byCurveAndHeight = Wall.ByCurveAndHeight(curve=LWallsFromGridL.walllines, height=LWallsFromGridL.wallHeight, level=LWallsFromGridL.wallLevel, wallType=LWallsFromGridL.wallstype)
floor_types = FloorTypes("Genérico 150 mm")
roofPointsGridL = Custom[roofPointsGridL](ColumnHeight=code_block.ColumnZ, roofType=floor_types, roofLevel=levels, posXs=gridLfromParam.posXs, posYs=gridLfromParam.posYs)  # frozen; Lateral Walls From Grid List
dimLinesfromGridL = Custom[DimLinesfromGridL](TotalDimOfset=code_block.TDimOffs, intDimOfset=code_block.IDimOffs, posXs=gridLfromParam.posXs, posYs=gridLfromParam.posYs)  # Dimension Lines from Grid Line
python_script = Python(IN[0]=dimLinesfromGridL.tDimLinesXs)
# ---------- python_script.python (45 lines) ----------
import clr
clr.AddReference('RevitAPI')
from Autodesk.Revit.DB import *
clr.AddReference('RevitServices')
import RevitServices
from RevitServices.Persistence import DocumentManager
from RevitServices.Transactions import TransactionManager
doc = DocumentManager.Instance.CurrentDBDocument
clr.AddReference('RevitNodes')
import Revit
clr.ImportExtensions(Revit.Elements)
clr.ImportExtensions(Revit.GeometryConversion)
from Revit.Elements import *
clr.AddReference('ProtoGeometry')
from Autodesk.DesignScript.Geometry import *

inNode0 = IN [0]
lineList = []
if isinstance(inNode0, list):
	lineList.extend(IN[0])
else:
	lineList.append(IN[0])
lineList = UnwrapElement(lineList)
lineListRevitType  = []

for l in lineList:
	lineListRevitType.append(l.ToRevitType(True)) #line se llamaba  

TransactionManager.Instance.EnsureInTransaction(doc)

detailCurveList  = []
line_List  = []
referencesList = []
dimensions = []
for i in range(len(lineList)):   #detail_curve
	detailCurveList.append(doc.Create.NewDetailCurve(doc.ActiveView, lineListRevitType[i]))
	line_List.append(UnwrapElement(detailCurveList[i]).GeometryCurve)
	referencesList.append(ReferenceArray())
	referencesList[i].Append(UnwrapElement(line_List[i]).GetEndPointReference(0))
	referencesList[i].Append(UnwrapElement(line_List[i]).GetEndPointReference(1))
	dimensions.append(doc.Create.NewDimension(doc.ActiveView, lineListRevitType[i], referencesList[i]))

TransactionManager.Instance.TransactionTaskDone()

OUT = dimensions
# ----------------------------------------
python_script_2 = Python(IN[0]=dimLinesfromGridL.tDimLinesYs)  # same code as python_script
python_script_3 = Python(IN[0]=dimLinesfromGridL.mDimLinesXs)  # same code as python_script
python_script_4 = Python(IN[0]=dimLinesfromGridL.mDimLinesYs)  # same code as python_script
structural_column_types = StructuralColumnTypes("UC305x305x97")
colfromGridL = Custom[ColfromGridL](ColumnHeight=code_block.ColumnZ, posXs=gridLfromParam.posXs, posYs=gridLfromParam.posYs)  # Column from GridList
code_block_3 = CodeBlock(level=levels, ctype=structural_column_types, lXsY0=colfromGridL.linesY0, lXsYn1=colfromGridL.linesYn1) { level; ctype; StructuralFraming.ColumnByCurve(lXsY0,level,ctype); StructuralFraming.ColumnByCurve(lXsYn1,level,ctype); }
