# Dynamo custom node ColfromGridL.dyf (Dynamo 1.3.2.2480)
# category: martinstaceynodes
# Column from GridList

ColumnHeight = Input()
posXs = Input()
posYs = Input()
code_block = CodeBlock(colHeight=ColumnHeight, posXs=posXs, posYs=posYs)
# ---------- code_block.designscript (29 lines) ----------
colHeight;
/*
def OfstWPoints(pointsType,posXs:var[],posYs:var[],offset,zval){
posX0 = List.GetItemAtIndex(posXs,0);
posY0 = List.GetItemAtIndex(posYs,0);
posXn1 = List.GetItemAtIndex(posXs,List.Count(posXs)-1);
posYn1 = List.GetItemAtIndex(posYs,List.Count(posYs)-1);
return = [Imperative] {
if    (pointsType=="pX0Ys" ) return=Point.ByCoordinates(posX0-offset,posYs,zval);
elseif(pointsType=="pXsY0" ) return=Point.ByCoordinates(posXs,posY0+offset,zval);
elseif(pointsType=="pXn1Ys") return=Point.ByCoordinates(posXn1+offset,posYs,zval);
elseif(pointsType=="pXsYn1") return=Point.ByCoordinates(posXs,posYn1-offset,zval);
elseif(pointsType=="pX0Y0")  return=Point.ByCoordinates(posX0-offset, posY0+offset,zval);
elseif(pointsType=="pXn1Y0") return=Point.ByCoordinates(posXn1+offset,posY0+offset,zval);
elseif(pointsType=="pX0Yn1") return=Point.ByCoordinates(posX0-offset, posYn1-offset,zval);
elseif(pointsType=="pXn1Yn1")return=Point.ByCoordinates(posXn1+offset,posYn1-offset,zval);
elseif(pointsType=="pXmYs" ) return=Point.ByCoordinates((posX0+posXn1)/2,posYs,zval);
elseif(pointsType=="pXsYm" ) return=Point.ByCoordinates(posXs,(posY0+posYn1)/2,zval);
else return= Point.ByCoordinates(0,0,0);
 }
};
*/

pXsY0  = OfstPoints("pXsY0",  posXs,posYs,0,0);
pXsYn1 = OfstPoints("pXsYn1", posXs,posYs,0,0);
pXsY0Z  = OfstPoints("pXsY0",  posXs,posYs,0,colHeight);
pXsYn1Z = OfstPoints("pXsYn1", posXs,posYs,0,colHeight);
lXsY0 =Line.ByStartPointEndPoint(pXsY0,pXsY0Z);
lXsYn1 =Line.ByStartPointEndPoint(pXsYn1,pXsYn1Z);
# ----------------------------------------
linesY0 = Output(code_block.lXsY0)
linesYn1 = Output(code_block.lXsYn1)
