# Dynamo custom node DimLinesfromGridL.dyf (Dynamo 1.3.2.2480)
# category: martinstaceynodes
# Dimension Lines from Grid Line

TotalDimOfset = Input()
intDimOfset = Input()
posXs = Input()
posYs = Input()
code_block = CodeBlock(TotalDimOfset, intDimOfset, posXs, posYs)
# ---------- code_block.designscript (22 lines) ----------
totDimOfst;
intDimOfst;
ptX0Ys  = OfstPoints("pX0Ys",  posXs,posYs,totDimOfst,0);
ptXsY0  = OfstPoints("pXsY0",  posXs,posYs,totDimOfst,0);
pmX0Ys  = OfstPoints("pX0Ys",  posXs,posYs,intDimOfst,0);
pmXsY0  = OfstPoints("pXsY0",  posXs,posYs,intDimOfst,0);
xlines= {};
ylines= {};
[Imperative] {
 for(i in 1..List.Count(pmXsY0)-1) {
  xlines[i] = Line.ByStartPointEndPoint(List.GetItemAtIndex(pmXsY0,i),List.GetItemAtIndex(pmXsY0,i-1));
  }
}
[Imperative] {
 for(i in 1..List.Count(pmX0Ys)-1) {
  ylines[i] = Line.ByStartPointEndPoint(List.GetItemAtIndex(pmX0Ys,i),List.GetItemAtIndex(pmX0Ys,i-1));
  }
}
tDimlXs = Line.ByStartPointEndPoint(List.GetItemAtIndex(ptXsY0,0),List.GetItemAtIndex(ptXsY0,List.Count(ptXsY0)-1));
tDimlYs = Line.ByStartPointEndPoint(List.GetItemAtIndex(ptX0Ys,0),List.GetItemAtIndex(ptX0Ys,List.Count(ptX0Ys)-1));
mDimlXs = List.Clean(xlines,false);
mDimlYs = List.Clean(ylines,false);
# ----------------------------------------
tDimLinesXs = Output(code_block.out10)
tDimLinesYs = Output(code_block.out11)
mDimLinesXs = Output(code_block.out12)
mDimLinesYs = Output(code_block.out13)
