# Dynamo custom node GridLfromExcel.dyf (Dynamo 1.3.2.2480)
# category: martinstaceynodes
# GridList from Excel File

ExcelFilePath = Input()
fromPath = FileObject(ExcelFilePath)  # "File.FromPath"
sheetName = Input()
code_block = CodeBlock(exfile=fromPath, sheetName=sheetName)
# ---------- code_block.designscript (13 lines) ----------
gridList =DSOffice.Excel.ReadFromFile(exfile,sheetName,false);
gridList = List.RemoveItemAtIndex(gridList,{0,1,2,3});
gridList = List.Transpose(gridList);
gridList = List.Clean(gridList,false);
nameList = DSOffice.Excel.ReadFromFile(exfile,sheetName,true);
nameList = List.RemoveItemAtIndex(nameList,{0,1,2,3});
nameList = List.Transpose(nameList);
nameList = List.Clean(nameList,false);

namesX = List.GetItemAtIndex(nameList,3);
namesY = List.GetItemAtIndex(nameList,0);
posXs = List.GetItemAtIndex(gridList,5);
posYs = -List.GetItemAtIndex(gridList,2);
# ----------------------------------------
namesX = Output(code_block.out2)
namesY = Output(code_block.out3)
posXs = Output(code_block.out4)
PosYs = Output(code_block.out5)
