# Dynamo custom node GridLfromParam.dyf (Dynamo 1.3.2.2480)
# category: martinstaceynodes
# Gets a GridList from Parameters

pointoffset_function = CodeBlock()
# ---------- pointoffset_function.designscript (37 lines) ----------
def OfstPoints(pointsType,posXs:var[],posYs:var[],offset,zval){
posX0 = List.GetItemAtIndex(posXs,0);
posY0 = List.GetItemAtIndex(posYs,0);
posXn1 = List.GetItemAtIndex(posXs,List.Count(posXs)-1);
posYn1 = List.GetItemAtIndex(posYs,List.Count(posYs)-1);
return = [Imperative] {
if    (pointsType=="pX0Ys" ) return=Point.ByCoordinates(posX0-offset,posYs,zval);
elseif(pointsType=="pXsY0" ) return=Point.ByCoordinates(posXs,posY0+offset,zval);
elseif(pointsType=="pXn1Ys") return=Point.ByCoordinates(posXn1+offset,posYs,zval);
elseif(pointsType=="pXsYn1") return=Point.ByCoordinates(posXs,posYn1-offset,zval);
elseif(pointsType=="pX0Y0")  return=Point.ByCoordinates(posX0-offset, posY0+offset,zval);
elseif(pointsType=="pXn1Y0") return=Point.ByCoordinates(posXn1+offset,posY0+offset,zval);
elseif(pointsType=="pX0Yn1") return=Point.ByCoordinates(posX0-offset, posYn1-offset,zval);
elseif(pointsType=="pXn1Yn1")return=Point.ByCoordinates(posXn1+offset,posYn1-offset,zval);
elseif(pointsType=="pXmYs" ) return=Point.ByCoordinates((posX0+posXn1)/2,posYs,zval);
elseif(pointsType=="pXsYm" ) return=Point.ByCoordinates(posXs,(posY0+posYn1)/2,zval);
else return= Point.ByCoordinates(0,0,0);
 }
};
def listfromparam(listtype, num, dist){
nlist= {};
[Imperative]{
 if (listtype == "NameA") for(i in 0..num-1) nlist[i] = numtolet(i);
  elseif (listtype == "Name1") for(i in 0..num-1) nlist[i] = numtostring(i);
  elseif (listtype == "PosX") for(i in 0..num-1) nlist[i] = dist * i;
  elseif (listtype == "PosY") for(i in 0..num-1) nlist[i] = -dist * i;
}
return = nlist;
};
def numtolet(number){
 alphabet = {"A","B","C","D","E","F","G","H","I","J","K","L","M","N","O","P","Q","R","S","T","U","V","Y","Z"};
 return = alphabet[number];
};
def numtostring(number){
 alphabet = {"1","2","3","4","5","6","7","8","9","10","11","12","13","14","15","16","17","18","19","20","21","22","23","24","25","26","27","28","29","30"};
 return = alphabet[number];
};
# ----------------------------------------
file_path = Filename(".\GridRevitExcel.xlsx")
fromPath = FileObject(file_path)  # "File.FromPath"
code_block = CodeBlock(fromPath)  # unwired: arg1
# ---------- code_block.designscript (14 lines) ----------
//EXCEL
gridList = Excel.ReadFromFile(exfile,"Grid",false);
gridList = List.RemoveItemAtIndex(gridList,{0,1,2,3});
gridList = List.Transpose(gridList);
gridList = List.Clean(gridList,false);
nameList = Excel.ReadFromFile(exfile,"Grid",true);
nameList = List.RemoveItemAtIndex(nameList,{0,1,2,3});
nameList = List.Transpose(nameList);
nameList = List.Clean(nameList,false);

namesX = List.GetItemAtIndex(nameList,3);
namesY = List.GetItemAtIndex(nameList,0);
posXs = List.GetItemAtIndex(gridList,5);
posYs = -List.GetItemAtIndex(gridList,2);
# ----------------------------------------
XNum = DoubleSlider(7, range=0..20 step 1)
XDist = DoubleSlider(6, range=0..20 step 0.1)
YNum = DoubleSlider(2, range=0..20 step 1)
YDist = DoubleSlider(18, range=0..20 step 0.1)
sliders = CodeBlock(XNum=XNum, XDist=XDist, YNum=YNum, YDist=YDist)
# ---------- sliders.designscript (5 lines) ----------
//SLIDERS
namesX = listfromparam("NameA",XNum,XDist);
namesY = listfromparam("Name1",YNum,YDist);
posXs = listfromparam("PosX",XNum,XDist);
posYs = listfromparam("PosY",YNum,YDist);
# ----------------------------------------
GridsX = Input()  # "# GridsX"
gap_GridsX = Input()
GridsY = Input()  # "# GridsY"
gap_GridsY = Input()
sliders_2 = CodeBlock(GridsX, gap_GridsX, GridsY, gap_GridsY)
# ---------- sliders_2.designscript (23 lines) ----------
def listfromparam(listtype, num, dist){
nlist= {};
[Imperative]{
 if (listtype == "NameA") for(i in 0..num-1) nlist[i] = numtolet(i);
  elseif (listtype == "Name1") for(i in 0..num-1) nlist[i] = numtostring(i);
  elseif (listtype == "PosX") for(i in 0..num-1) nlist[i] = dist * i;
  elseif (listtype == "PosY") for(i in 0..num-1) nlist[i] = -dist * i;
}
return = nlist;
};
def numtolet(number){
 alphabet = {"A","B","C","D","E","F","G","H","I","J","K","L","M","N","O","P","Q","R","S","T","U","V","Y","Z"};
 return = alphabet[number];
};
def numtostring(number){
 alphabet = {"1","2","3","4","5","6","7","8","9","10","11","12","13","14","15","16","17","18","19","20","21","22","23","24","25","26","27","28","29","30"};
 return = alphabet[number];
};

namesX = listfromparam("NameA",XNum,XDist);
namesY = listfromparam("Name1",YNum,YDist);
posXs = listfromparam("PosX",XNum,XDist);
posYs = listfromparam("PosY",YNum,YDist);
# ----------------------------------------
namesX = Output(sliders_2.out0)
namesY = Output(sliders_2.out1)
posXs = Output(sliders_2.out2)
posYs = Output(sliders_2.out3)
