# Dynamo custom node GridsfromGridL.dyf (Dynamo 1.3.3.4651)
# category: martinstaceynodes
# Grids Drawn From GridList

gridOfst = Input()
namesX = Input()
namesY = Input()
posXs = Input()
posYs = Input()
gridLines = CodeBlock(gridOfst=gridOfst, namesX=namesX, namesY=namesY, posXs=posXs, posYs=posYs)
# ---------- gridLines.designscript (13 lines) ----------
gridOfst;
namesX;
namesY;
gpX0Ys = OfstPoints("pX0Ys" ,posXs,posYs,gridOfst,0);
gpXn1Ys = OfstPoints("pXn1Ys",posXs,posYs,gridOfst,0);
gpXsY0 =OfstPoints("pXsY0" ,posXs,posYs,gridOfst,0);
gpXsYn1 =OfstPoints("pXsYn1",posXs,posYs,gridOfst,0);
lgX=Line.ByStartPointEndPoint(gpXsY0,gpXsYn1);
lgY=Line.ByStartPointEndPoint(gpX0Ys,gpXn1Ys);
namesX;
namesY;
gX = Grid.SetParameterByName(Grid.ByLine(lgX),"Name",namesX);
gY = Grid.SetParameterByName(Grid.ByLine(lgY),"Name",namesY);
# ----------------------------------------
GridsX = Output(gridLines.out11)
GridsY = Output(gridLines.out12)
