# Dynamo custom node LWallsFromGridL.dyf (Dynamo 1.3.2.2480)
# category: martinstaceynodes
# Lateral Walls From Grid List

ColumnHeight = Input()
wallLevel = Input()
wallType = Input()
posXs = Input()
posYs = Input()
code_block = CodeBlock(colHeight=ColumnHeight, walllevel=wallLevel, wt=wallType, posXs=posXs, posYs=posYs)
# ---------- code_block.designscript (14 lines) ----------
colHeight;
walllevel;
wt;
pXsY0Z  = OfstPoints("pXsY0",  posXs,posYs,0,0);
pXsYn1Z = OfstPoints("pXsYn1",  posXs,posYs,0,0);
lXsY0Z = Line.ByStartPointEndPoint(List.GetItemAtIndex(pXsY0Z,0),List.GetItemAtIndex(pXsY0Z,List.Count(pXsY0Z)-1));
lXsYn1Z = Line.ByStartPointEndPoint(List.GetItemAtIndex(pXsYn1Z,0),List.GetItemAtIndex(pXsYn1Z,List.Count(pXsYn1Z)-1));

offstval = wt.GetParameterValueByName("Width")/2;

l1Of = lXsY0Z.Offset(-offstval);
l2Of = lXsYn1Z.Offset(offstval);

allwalls = {l1Of,l2Of};
# ----------------------------------------
walllines = Output(code_block.allwalls)
wallHeight = Output(code_block.colHeight)
wallLevel_2 = Output(code_block.walllevel)  # "wallLevel"
wallstype = Output(code_block.wt)
