# Dynamo custom node OfstPointsFunction.dyf (Dynamo 1.3.2.2480)
# category: martinstaceynodes
# Offset Points Function

code_block = CodeBlock()
# ---------- code_block.designscript (22 lines) ----------
def OfstPoints(pointsType,posXs:var[],posYs:var[],offset,zval){
posX0 = List.GetItemAtIndex(posXs,0);
posY0 = List.GetItemAtIndex(posYs,0);
posXn1 = List.GetItemAtIndex(posXs,List.Count(posXs)-1);
posYn1 = List.GetItemAtIndex(posYs,List.Count(posYs)-1);
return = [Imperative] {
if    (pointsType=="pX0Ys" ) return=Point.ByCoordinates(posX0-offset,posYs,zval);
elseif(pointsType=="pXsY0" ) return=Point.ByCoordinates(posXs,posY0+offset,zval);
elseif(pointsType=="pXn1Ys") return=Point.ByCoordinates(posXn1+offset,posYs,zval);
elseif(pointsType=="pXsYn1") return=Point.ByCoordinates(posXs,posYn1-offset,zval);
elseif(pointsType=="pX0Y0")  return=Point.ByCoordinates(posX0-offset, posY0+offset,zval);
elseif(pointsType=="pXn1Y0") return=Point.ByCoordinates(posXn1+offset,posY0+offset,zval);
elseif(pointsType=="pX0Yn1") return=Point.ByCoordinates(posX0-offset, posYn1-offset,zval);
elseif(pointsType=="pXn1Yn1")return=Point.ByCoordinates(posXn1+offset,posYn1-offset,zval);
elseif(pointsType=="pX0Ym")return=Point.ByCoordinates((posX0+posXn1)/2,posYn1-offset,zval);
elseif(pointsType=="pXn1Ym")return=Point.ByCoordinates((posX0+posXn1)/2,posYn1-offset,zval);
elseif(pointsType=="pXmYs" ) return=Point.ByCoordinates((posX0+posXn1)/2,posYs,zval);
elseif(pointsType=="pXsYm" ) return=Point.ByCoordinates(posXs,(posY0+posYn1)/2,zval);

else return= Point.ByCoordinates(0,0,0);
 }
};
# ----------------------------------------
