# Dynamo custom node roofPointsGridL.dyf (Dynamo 1.3.3.4651)
# category: martinstaceynodes
# Lateral Walls From Grid List

ColumnHeight = Input()
roofLevel = Input()
roofType = Input()
posXs = Input()
posYs = Input()
code_block = CodeBlock(colHeight=ColumnHeight, rooflevel=roofLevel, wt=roofType, posXs=posXs, posYs=posYs)  # unwired: l1Of, l2Of
# ---------- code_block.designscript (9 lines) ----------
colHeight;
rooflevel;
wt;
pXsY0Z  = OfstPoints("pXsY0",  posXs,posYs,0,colHeight);
pXsYn1Z = OfstPoints("pXsYn1",  posXs,posYs,0,colHeight);
lXsY0Z = Line.ByStartPointEndPoint(List.GetItemAtIndex(pXsY0Z,0),List.GetItemAtIndex(pXsY0Z,List.Count(pXsY0Z)-1));
lXsYn1Z = Line.ByStartPointEndPoint(List.GetItemAtIndex(pXsYn1Z,0),List.GetItemAtIndex(pXsYn1Z,List.Count(pXsYn1Z)-1));

allwalls = {l1Of,l2Of};
# ----------------------------------------
roofLevel_2 = Output(code_block.rooflevel)  # "roofLevel"
rooftype = Output(code_block.wt)
