# Dynamo custom node trussFramefromGridL.dyf (Dynamo 1.3.2.2480)
# category: martinstaceynodes
# Truss Frame from GridL

ColumnHeight = Input()
summitHeight = Input()
trussHeight = Input()
trussX = Input()
posXs = Input()
posYs = Input()
code_block = CodeBlock(colHeight=ColumnHeight, sumHeight=summitHeight, trussHeight=trussHeight, trussX=trussX, posXs=posXs, posYs=posYs)
# ---------- code_block.designscript (40 lines) ----------
/*
def OfstTPoints(pointsType,posXs:var[],posYs:var[],offset,zval){
posX0 = List.GetItemAtIndex(posXs,0);
posY0 = List.GetItemAtIndex(posYs,0);
posXn1 = List.GetItemAtIndex(posXs,List.Count(posXs)-1);
posYn1 = List.GetItemAtIndex(posYs,List.Count(posYs)-1);
return = [Imperative] {
if    (pointsType=="pX0Ys" ) return=Point.ByCoordinates(posX0-offset,posYs,zval);
elseif(pointsType=="pXsY0" ) return=Point.ByCoordinates(posXs,posY0+offset,zval);
elseif(pointsType=="pXn1Ys") return=Point.ByCoordinates(posXn1+offset,posYs,zval);
elseif(pointsType=="pXsYn1") return=Point.ByCoordinates(posXs,posYn1-offset,zval);
elseif(pointsType=="pX0Y0")  return=Point.ByCoordinates(posX0-offset, posY0+offset,zval);
elseif(pointsType=="pXn1Y0") return=Point.ByCoordinates(posXn1+offset,posY0+offset,zval);
elseif(pointsType=="pX0Yn1") return=Point.ByCoordinates(posX0-offset, posYn1-offset,zval);
elseif(pointsType=="pXn1Yn1")return=Point.ByCoordinates(posXn1+offset,posYn1-offset,zval);
elseif(pointsType=="pXmYs" ) return=Point.ByCoordinates((posX0+posXn1)/2,posYs,zval);
elseif(pointsType=="pXsYm" ) return=Point.ByCoordinates(posXs,(posY0+posYn1)/2,zval);
else return= Point.ByCoordinates(0,0,0);
 }
};
*/
colHeight;
sumHeight;
trussHeight;
trussX;

pXsY0Z  = OfstPoints("pXsY0",  posXs,posYs,0,colHeight);
pXsYn1Z = OfstPoints("pXsYn1", posXs,posYs,0,colHeight);
ptrXsY0  =OfstPoints("pXsY0",  posXs,posYs,-trussX,colHeight);
ptrXsYn1 =OfstPoints("pXsYn1", posXs,posYs,-trussX,colHeight);
pSum=OfstPoints("pXsYm",  posXs,posYs,0,sumHeight);
pInf =OfstPoints("pXsYm",  posXs,posYs,0,trussHeight);
ptrXsY0Z =OfstPoints("pXsY0",  posXs,posYs,-trussX,colHeight);
ptrXsYn1Z=OfstPoints("pXsYn1", posXs,posYs,-trussX,colHeight);
lSUtoY0 = Line.ByStartPointEndPoint(pXsY0Z,pSum);
lSUtoYn1 =Line.ByStartPointEndPoint(pXsYn1Z,pSum);
lINtoYtr0 =Line.ByStartPointEndPoint(ptrXsY0,pInf);
lINtoYtrn1 =Line.ByStartPointEndPoint(ptrXsYn1,pInf);
lCOtoYtr0 =Line.ByStartPointEndPoint(ptrXsY0,pXsY0Z);
lCOtoYtrn1 =Line.ByStartPointEndPoint(ptrXsYn1,pXsYn1Z);
# ----------------------------------------
lineSummittoYo = Output(code_block.lSUtoY0)
lineColumntoIntLineYn0 = Output(code_block.lCOtoYtr0)
lineInferiorTrtoYn1 = Output(code_block.lINtoYtrn1)
lineSummittoYn1 = Output(code_block.lSUtoYn1)
lineInferiorTrtoY0 = Output(code_block.lINtoYtr0)
lineColumntoIntLineYn1 = Output(code_block.lCOtoYtrn1)
